# Grasshopper definition K-mean Clustering final [Dec-23 '22, 2342].gh (Grasshopper 1.0.7)
# plug-ins: Bifocals, Owl.GH, MeshEdit Components, Kangaroo Components, Pufferfish, NGon, Weaverbird, Human, Kangaroo2 Components, Box2D

# ---- group: Amount of Pieces
sqgrid = Square(Plane=PlaneXY(0, 0, 0), Size=Slider(5, range=0..100), ExtentX=Slider(6, range=0..100), ExtentY=Slider(10, range=0..100))  # -> Cells, Points; disabled

# ---- group: num_edges range
dom = ConstructDomain(DomainStart=Slider(4, range=0..10), DomainEnd=Slider(7, range=0..10))

# ---- group: random radius range
dom_2 = ConstructDomain(DomainStart=Slider(2, range=0..10), DomainEnd=Slider(5, range=0..10))

# ---- group: contouring
# Script by Daniel Piker 03/07/2020
#     This is an implementation of "The Heat Method for Distance Computation"
#     by Keenan Crane, Clarisse Weischedel and Max Wardetzky
#     https://www.cs.cmu.edu/~kmcrane/Projects/HeatMethod/
surface = Surface(<surface referenced from the Rhino model>)  # disabled
triangulate = Triangulate(Mesh=surface)  # -> Mesh, Count; disabled
number_slider = Slider(3, range=0..10)  # disabled
weaverbird_s_catmull_clark_subdivision = WeaverbirdsCatmullClarkSubdivision(MeshCurves=triangulate.Mesh, Level=number_slider, SmoothNakedEdges=0)  # disabled
surface_2 = Surface(<surface referenced from the Rhino model>)  # disabled
mesh_brep = MeshBrep(
    Brep=surface_2,
    Settings={GridMaxCount=0, GridMinCount=16, JaggedSeams=False, MaxEdgeLength=0, MinEdgeLength=0.0001, MinTolerance=0, Refine=True, RefineAngle=0, RelativeTolerance=0.65, SimplePlanes=True, Tolerance=0})  # disabled
triangulate_2 = Triangulate(Mesh=weaverbird_s_catmull_clark_subdivision)  # -> Mesh, Count; disabled
mesh = Mesh(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)  # disabled
mesh_2 = Mesh(triangulate_2.Mesh)  # disabled
point = Point([Point(290.2129716, 50.51523418, 4.957152759), Point(301.5916072, 10.64762466, 0), Point(275.5167252, 8.444722066, -0.06509434225)])  # disabled
panel = Panel("1000")  # disabled
pulltomesh = PullToMesh(ConstraintMesh=mesh_2, Points=point, PullStrength=panel)  # disabled
outputvalues = BooleanToggle(True)  # disabled
number_slider_2 = Slider(1, range=0..1)  # disabled
poisson = BooleanToggle(True)  # disabled
reset = Button()  # disabled
run = BooleanToggle(True)  # disabled
timer = Timer(Interval=10, TimerInterval=10, Target=distance_heatmethod)  # disabled
distance_heatmethod = CSharpScript(
    P=mesh_2,
    heatPoints=pulltomesh,
    textureScale=number_slider_2,
    step=run,
    Poisson=poisson,
    reset=reset,
    Output=outputvalues,
    Reference=["C:\Users\libish m\AppData\Roaming\Grasshopper\Libraries\Plankton.dll", "C:\Users\libish m\AppData\Roaming\Grasshopper\Libraries\Plankton.gha"])  # -> out, Mesh, Values, Gradient; inputs P: Mesh, heatPoints: list of Point3d, textureScale: Double, step: Boolean, Poisson: Boolean, reset: Boolean, Output: Boolean; disabled
# ---------- distance_heatmethod: C# usings ----------
using Plankton;
using PlanktonGh;
using System.Linq;
using System.Threading.Tasks;
# ---------- distance_heatmethod: C# ----------
    /*
    Script by Daniel Piker 03/07/2020
    This is an implementation of "The Heat Method for Distance Computation"
    by Keenan Crane, Clarisse Weischedel and Max Wardetzky
    https://www.cs.cmu.edu/~kmcrane/Projects/HeatMethod/
    */
    if(reset || pm == null)
    {
      pm = P.ToPlanktonMesh();
      int vc = pm.Vertices.Count;
      storedweights = new double[vc][];
      storedneighbours = new int[vc][];
      values = new double[vc];
      fix = new bool[vc];
      for(int i = 0;i < vc;i++)
      {
        storedweights[i] = cotanWeights(pm, i);
        storedneighbours[i] = pm.Vertices.GetVertexNeighbours(i);
        values[i] = 1;
        for(int j = 0;j < heatPoints.Count;j++)
        {
          if(pm.Vertices[i].ToPoint3d().DistanceToSquared(heatPoints[j]) < 0.001)
          {
            values[i] = 0;
            fix[i] = true;
          }
        }

      }
      gradient = new Vector3d[vc];
      meshOut = P.DuplicateMesh();
    }

    if(step)
    {
      if(!Poisson)
      {
        for(int k = 0;k < 100;k++)
        {
          double[] newValues = new double[values.Length];
          Parallel.For(0, pm.Vertices.Count,
            i => {
            if(!fix[i] && !pm.Vertices.IsBoundary(i))
            {
              int[] neighbours = storedneighbours[i];
              double[] weights = storedweights[i];
              double newValue = 0;
              for(int j = 0;j < neighbours.Length;j++)
              {
                newValue += weights[j] * values[neighbours[j]];
              }
              newValues[i] = newValue;
            }
            else newValues[i] = 0;
            });
          values = newValues;
        }
        gradient = gradients(pm, values);
        edgeGradient = null;
      }

      else
      {
        if(edgeGradient == null)
        {
          edgeGradient = new Vector3d[pm.Halfedges.Count / 2];
          for(int i = 0;i < pm.Halfedges.Count / 2;i++)
          {
            int start = pm.Halfedges[2 * i].StartVertex;
            int end = pm.Halfedges[(2 * i) + 1].StartVertex;
            Vector3d sv = gradient[start];
            Vector3d ev = gradient[end];
            sv.Unitize();
            ev.Unitize();
            Vector3d avgGradient = sv + ev;
            avgGradient.Unitize();
            edgeGradient[i] = avgGradient;
          }
        }
        for(int k = 0;k < 100;k++)
        {
          double[] heChange = new double[pm.Halfedges.Count];
          Parallel.For(0, pm.Halfedges.Count / 2,
            i => {
            int start = pm.Halfedges[2 * i].StartVertex;
            int end = pm.Halfedges[(2 * i) + 1].StartVertex;
            Vector3d edgeVector = pm.Vertices[end].ToPoint3d() - pm.Vertices[start].ToPoint3d();
            double projected = edgeVector * edgeGradient[i];
            double currentDifference = values[end] - values[start];
            double change = currentDifference - projected;
            heChange[2 * i] = 0.5 * change;
            heChange[(2 * i) + 1] = -0.5 * change;
            });

          Parallel.For(0, pm.Vertices.Count,
            i => {
            //if(fix[i])
            //{
            //  values[i] = 0;
            //}
            //else
            {
              double[] weights = storedweights[i];
              int[] halfedges = pm.Vertices.GetHalfedges(i);
              for(int j = 0;j < halfedges.Length;j++)
              {
                values[i] += heChange[halfedges[j]] * weights[j];
              }
            }
            });

        }
      }
    }


    for(int i = 0;i < meshOut.Vertices.Count;i++)
    {
      meshOut.TextureCoordinates.SetTextureCoordinate(i, new Point2f(0, (float) (values[i] * textureScale)));
    }

    Mesh = meshOut;
    //the scalar and gradient vectors per vertex should you want them, though outputing these lists slows things down, so not included by default
    if(Output)
    {
      Values = values;
      Gradient = gradient;
    }
# ---------- distance_heatmethod: C# additional code ----------
  PlanktonMesh pm;
  double[] values;
  double[][] storedweights;
  int[][] storedneighbours;
  Vector3d[] gradient;
  Vector3d[] edgeGradient;
  bool[] fix;
  Mesh meshOut;

  static Vector3d[] gradients(PlanktonMesh P, double[] values)
  {
    Vector3d[] halfedgeGradients = new Vector3d[P.Halfedges.Count];
    for(int i = 0;i < P.Halfedges.Count / 2;i++)
    {
      int start = P.Halfedges[2 * i].StartVertex;
      int end = P.Halfedges[2 * i + 1].StartVertex;
      Vector3d v = P.Vertices[end].ToPoint3d() - P.Vertices[start].ToPoint3d();
      double lengthSquared = v.SquareLength;
      double diff = values[end] - values[start];
      Vector3d edgeGradient = v * (diff / lengthSquared);
      halfedgeGradients[2 * i] = halfedgeGradients[2 * i + 1] = edgeGradient;
    }
    Vector3d[] vertexGradients = new Vector3d[P.Vertices.Count];
    for(int i = 0;i < P.Vertices.Count;i++)
    {
      double[] weights = cotanWeights(P, i);
      Vector3d gradient = new Vector3d();
      int[] halfedges = P.Vertices.GetHalfedges(i);
      for(int j = 0;j < halfedges.Length;j++)
      {
        gradient += halfedgeGradients[halfedges[j]] * weights[j];
      }
      vertexGradients[i] = gradient;
    }
    return vertexGradients;
  }

  static double[] cotanWeights(PlanktonMesh P, int i)
  {
    int[] Neighbours = P.Vertices.GetVertexNeighbours(i);
    Point3d Vertex = P.Vertices[i].ToPoint3d();
    int valence = P.Vertices.GetValence(i);
    Point3d[] NeighbourPts = new Point3d[valence];
    Vector3d[] Radial = new Vector3d[valence];
    Vector3d[] Around = new Vector3d[valence];
    double[] CotWeight = new double[valence];
    double WeightSum = 0;
    for (int j = 0; j < valence; j++)
    {
      NeighbourPts[j] = P.Vertices[Neighbours[j]].ToPoint3d();
      Radial[j] = NeighbourPts[j] - Vertex;
    }
    for (int j = 0; j < valence; j++)
    {
      Around[j] = NeighbourPts[(j + 1) % valence] - NeighbourPts[j];
    }
    for (int j = 0; j < Neighbours.Length; j++)
    {
      int previous = (j + valence - 1) % valence;
      Vector3d Cross1 = Vector3d.CrossProduct(Radial[previous], Around[previous]);
      double Dot1 = Radial[previous] * Around[previous];
      int next = (j + 1) % valence;
      Vector3d Cross2 = Vector3d.CrossProduct(Radial[next], Around[j]);
      double Dot2 = Radial[next] * Around[j];
      CotWeight[j] = Math.Abs(Dot1 / Cross1.Length) + Math.Abs(Dot2 / Cross2.Length);
      WeightSum += CotWeight[j];
    }
    for (int j = 0; j < CotWeight.Length; j++) CotWeight[j] /= WeightSum;
    return CotWeight;
  }
# ---------- end distance_heatmethod ----------
path = FilePath("D:\Pictures\RAINBOW_TEXTURE.jpg")  # disabled
c_script = CSharpScript(texture=path)  # -> out, A; inputs texture: String; disabled
# ---------- c_script: C# usings ----------
using Rhino.DocObjects;
# ---------- c_script: C# ----------
    Material material = new Material();
    material.SetBitmapTexture(texture);
    A = new GH_Material(Rhino.Render.RenderMaterial.CreateBasicMaterial(material));
# ---------- end c_script ----------
panel_2 = Panel("4")  # disabled
curve = Curve(distance_heatmethod.Mesh)  # disabled
preview = CustomPreview(Geometry=distance_heatmethod.Mesh, Material=c_script.A)  # disabled
vector = Vector(distance_heatmethod.Values)  # disabled
c_script_2 = CSharpScript(M=distance_heatmethod.Mesh, contourCount=panel_2)  # -> out, Contours; inputs M: Mesh, contourCount: Int32; disabled
# ---------- c_script_2: C# usings ----------
using System.Linq;
using System.Threading.Tasks;
# ---------- c_script_2: C# ----------
    List<Line> all = new List<Line>();
    List<Line>[] contours = new List<Line>[contourCount];
    double[] values = new double[M.Vertices.Count];
    for(int i = 0;i < M.Vertices.Count;i++) values[i] = M.TextureCoordinates[i].Y;
    double lower = values.Min();
    double upper = values.Max();
    double stepsize = (upper - lower) / (contourCount + 1.0);

    Parallel.For(0, contourCount,
      j => {
      double iso = lower + ((j + 1) * stepsize);
      List<Line> lines = new List<Line>();
      for(int i = 0;i < M.Faces.Count;i++)
      {
        int va = M.Faces[i].A;
        int vb = M.Faces[i].B;
        int vc = M.Faces[i].C;
        double a = M.TextureCoordinates[va].Y - iso;
        double b = M.TextureCoordinates[vb].Y - iso;
        double c = M.TextureCoordinates[vc].Y - iso;
        Point3d pa = M.Vertices.Point3dAt(va);
        Point3d pb = M.Vertices.Point3dAt(vb);
        Point3d pc = M.Vertices.Point3dAt(vc);
        
        List<Point3d> ends = new List<Point3d>();
        if(a < 0 != b < 0)
        {
          double wa = b / (b - a);
          double wb = 1 - wa;
          ends.Add(wa * pa + wb * pb);
        }
        if(a < 0 != c < 0)
        {
          double wa = c / (c - a);
          double wc = 1 - wa;
          ends.Add(wa * pa + wc * pc);
        }
        if(c < 0 != b < 0)
        {
          double wb = c / (c - b);
          double wc = 1 - wb;
          ends.Add(wb * pb + wc * pc);
        }
        if(ends.Count == 2) lines.Add(new Line(ends[0], ends[1]));
      }
      contours[j] = lines;
      });

    DataTree<Line> contoursTree = new DataTree<Line>();
    for(int i = 0; i < contourCount;i++)
    {
      GH_Path path = new GH_Path(i);
      for (int j = 0; j < contours[i].Count;j++)
      {
        contoursTree.Add(contours[i][j], path);
      }
    }

    Contours = contoursTree;
# ---------- end c_script_2 ----------
amplitude = Amplitude(Vector=distance_heatmethod.Values, Amplitude=distance_heatmethod.Values)  # disabled
curve_2 = Curve(c_script_2.Contours)  # disabled
mesh_3 = Mesh(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)  # disabled
curve_3 = Curve(Tree({0}: [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], {1}: [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], {2}: [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], {3}: [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], {4}: [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], {5}: [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], {6}: [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], {7}: [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], {8}: [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], {9}: [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]))  # disabled
curve_4 = Curve(Tree({0}: [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], {1}: [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], {2}: [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], {3}: [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], {4}: [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], {5}: [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]))  # disabled
curve_5 = Curve([<curve referenced from the Rhino model> x4])  # disabled
mesh_4 = Mesh(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)  # disabled
pt = Point(Point(-12186.75265, -108260.7841, 118.6592048))  # disabled
join_curves = JoinCurves(Curves=curve_2, Preserve=False)  # disabled
button = Button()  # disabled
bake_geometry = BakeGeometry(Bake=button, Geometry=join_curves, DeleteOldBakes=False, PreserveTrees=False)  # disabled

# ----
surface_3 = Surface(<surface referenced from the Rhino model>)  # disabled
custom_preview = CustomPreview(
    Geometry=surface,
    Material={diffuse=RGB(221, 160, 221), emission=RGB(66, 48, 66), shine=0.5, specular=RGB(255, 255, 255), transparency=0})
curve_6 = Curve([<curve referenced from the Rhino model> x3])

# ---- group: contouring / Area centroid of vectors
mesh_area = MeshArea(Mesh=mesh_2)  # -> Area, Centroid; disabled

# ----
merge = Merge(
    Data1=ColourSwatch(SwatchColor=RGB(255, 0, 0)),
    Data2=ColourSwatch(SwatchColor=RGB(255, 183, 0)),
    Data3=ColourSwatch(SwatchColor=RGB(0, 153, 255)),
    Data4=ColourSwatch(SwatchColor=RGB(110, 255, 0)))  # -> graft(Result)
pt_2 = Point(Point(238.9796026, 51.19313825, 0))
subd = SubD(<subd referenced from the Rhino model>)
curve_7 = Curve([<curve referenced from the Rhino model> x3])
curve_8 = Curve([<curve referenced from the Rhino model> x4])
cir = Circle(Plane=pt_2, Radius=[Slider(58, range=0..100), Slider(67, range=0..100), Slider(51, range=0..100)])
length = Length(Curve=cir)  # -> flatten(Length)
mesh_from_subd = MeshFromSubD(SubD=subd, Density=2)
construct_domain = ConstructDomain(DomainStart=Slider(1, range=0..10), DomainEnd=Slider(5, range=0..10))
length_2 = Length(Curve=curve_8)
bounds = Bounds(Numbers=length_2)
range = Range(Domain=construct_domain, Steps=10)
Z = UnitZ(Factor=1)
mesh_to_polysurface = MeshToPolysurface(Mesh=mesh_from_subd, Triangles=False, FaceMerge=False)
mesh_5 = Mesh(<mesh referenced from the Rhino model>)

sqgrid_2 = Square(Plane=PlaneXY(0, 0, 0), Size=Slider(5, range=0..100), ExtentX=Slider(5, range=0..100), ExtentY=Slider(5, range=0..100))  # -> Cells, Points

division = Division(A=length_2, B=Slider(8, range=0..100))
round = Round(Number=division)  # -> Nearest, Floor, Ceiling
divide_curve = DivideCurve(Curve=curve_8, Count=round.Nearest, Kinks=False)  # -> Points, Tangents, Parameters
pull_point = PullPoint(Point=divide_curve.Points, Geometry=mesh_to_polysurface, ClosestOnly=True)  # -> ClosestPoint, Distance
nurbs_curve = NurbsCurve(Vertices=divide_curve.Points, Degree=3, Periodic=False)  # -> Curve, Length, Domain
boundaryfirstflatenning = BoundaryFirstFlatenning(Mesh=mesh_5, MapToSphere=False)  # -> Mesh3D, Mesh2D
param_viewer = ParamViewer(divide_curve.Points)
Z_2 = UnitZ(Factor=1)
explode_tree = ExplodeTree(Data=divide_curve.Tangents)  # -> Branch0, Branch1, Branch2, Branch3
vrot = Rotate(Vector=divide_curve.Tangents, Axis=Z_2, Angle="pi/3")
pl = ConstructPlane(Origin=divide_curve.Points, XAxis=vrot, YAxis=Vector(0, 1, 0))
last_index = LastIndex(List=explode_tree.Branch1)  # -> expr("x+1", Index)
last_index_2 = LastIndex(List=explode_tree.Branch2)  # -> expr("x+1", Index)
curve_9 = Curve(<curve referenced from the Rhino model>)
join_curves_2 = JoinCurves(Curves=curve_9, Preserve=False)
number_slider_3 = Slider(1.1, range=0..10)
radii = Radii(number_slider_3)

# ---- group: ViewPort Interaction (Hold Alt + Left Mouse Button)
grab = Grab(On=True, Strength=1, Range=3)

# ----
reset_2 = Button()
on = BooleanToggle(True)

area = Area(Geometry=flatten(sqgrid_2.Cells))  # -> Area, Centroid
# Generate Random Pieces
pt_3 = Point(graft(area.Centroid))
lng = ListLength(List=area.Centroid)
random = Random(Range="20000", Number=lng, Seed=2)  # -> flatten(Random)
random_2 = Random(Range=dom, Number=lng, Seed=2)
random_3 = Random(Range=Domain(0, 1), Number=random_2, Seed=random)
sort = SortList(Keys=random_3)  # -> Keys, ValuesA
random_4 = Random(Range=dom_2, Number=random_2, Seed=2)
pt_4 = Point(pt_3)

# ---- group: initial radius
cir_2 = Circle(Plane=pt_3, Radius=Slider(5, range=0..10))

# ---- group: random scaling range
random_5 = Random(Range=" 0.2 to 1", Number=lng, Seed=2)  # -> graft(Random)

# ----
eval = EvaluateCurve(Curve=reparameterize(cir_2), Parameter=sort.Keys)  # -> Point, Tangent, Angle
vec2pt = Vector2Pt(PointA=pt_3, PointB=eval.Point, Unitize=False)  # -> Vector, Length
amp = Amplitude(Vector=vec2pt.Vector, Amplitude=random_4)
move = Move(Geometry=pt_3, Motion=amp)  # -> Geometry, Transform
hull = ConvexHull(Points=move.Geometry, Plane=PlaneXY(0, 0, 0))  # -> Hull, HullZ, Indices
scale = Scale(Geometry=hull.Hull, Center=pt_4, Factor=random_5)  # -> Geometry, Transform

# ---- group: Contours
# Length
crv = Curve(flatten(scale.Geometry))

# ----
convexdecompose = ConvexDecompose(Polygon=crv)
curve_10 = Curve(convexdecompose)
populate_geometry = PopulateGeometry(Geometry=curve_10, Count=100, Seed=1)
lng_2 = ListLength(List=crv)
# Sides
explode = Explode(Curve=crv, Recursive=True)  # -> Segments, Vertices
# Area
area_2 = Area(Geometry=crv)  # -> Area, Centroid
len = Length(Curve=crv)
# Proportions
# Convexity
divide = DivideCurve(Curve=crv, Count=10, Kinks=False)  # -> Points, Tangents, Parameters
crv_2 = Curve(explode.Segments)
# Angles
shift = ShiftList(List=crv_2, Shift=1, Wrap=True)
fline = FitLine(Points=divide.Points)
angle = Angle(VectorA=crv_2, VectorB=shift)  # -> Angle, Reflex
lng_3 = ListLength(List=explode.Segments)  # -> flatten(Length)
curvepoint = PointOnCurve(fline, parameter=0.5)
deg = Degrees(Radians=angle.Angle)
number_of_sides = Panel(lng_3)
area_3 = Panel(area_2.Area)
length_3 = Panel(len)
angles = Panel(deg)
crv_3 = Curve(graft(crv))
pl_2 = ConstructPlane(Origin=curvepoint, XAxis=fline, YAxis=Vector(0, 1, 0))
bbox = BoundingBox(Content=crv_3, Plane=pl_2)  # -> Box, Box_2
sort_2 = SortList(Keys=angles)  # -> Keys, ValuesA
debox = DeconstructBox(Box=bbox.Box)  # -> Plane, X, Y, Z

# ---- group: Min Angle
item = ListItem(List=sort_2.Keys, Index="0", Wrap=True)

# ---- group: Maximum Angle
item_2 = ListItem(List=sort_2.Keys, Index="-1", Wrap=True)

# ----
dedomain = DeconstructDomain(Domain=debox.Y)  # -> Start, End
dedomain_2 = DeconstructDomain(Domain=debox.X)  # -> Start, End
subtraction = Subtraction(A=dedomain.End, B=dedomain.Start)
subtraction_2 = Subtraction(A=dedomain_2.End, B=dedomain_2.Start)
Y = Number(subtraction)
X = Number(subtraction_2)
multiplication = Multiplication(A=X, B=Y)  # -> flatten(Result)
division_2 = Division(A=Y, B=X)
division_3 = Division(A=area_3, B=multiplication)
number_of_sides_2 = Number(flatten(number_of_sides))
proportions = Number(flatten(division_2))
num_of_crvs = Number(lng_2)
squarishness = Number(flatten(division_3))
max_angle = Number(flatten(item_2))
min_angle = Number(flatten(item))
area_4 = Number(flatten(area_3))
length_4 = Number(flatten(length_3))
range_2 = Range(Domain=Domain(0, 1), Steps=num_of_crvs)
gradient = Gradient(LowerLimit=0, UpperLimit=1, Parameter=range_2, stops=[0.15: RGB(255, 130, 160), 0.85: RGB(220, 0, 40)])
sort_3 = SortList(Keys=area_4, ValuesA=crv)  # -> Keys, ValuesA
entwine = Entwine(Branch00=area_4, Branch01=squarishness, Branch02=proportions, FlattenInputs=True)
boundary = BoundarySurfaces(Edges=sort_3.ValuesA)
clean = CleanTree(RemoveNulls=True, RemoveInvalid=True, RemoveEmpty=invert(False), Tree=entwine)
bnd = Bounds(Numbers=clean)
preview_2 = CustomPreview(Geometry=boundary, Material=gradient)
remap = RemapNumbers(Value=clean, Source=bnd, Target=Domain(0, 1))  # -> Mapped, Clipped
flip = FlipMatrix(Data=remap.Mapped)
datatree_to_tensorset = DataTreeToTensorSet(DataTree=flip)  # "DT->TS"
detset = DeconstructTensorSet(TensorSet=datatree_to_tensorset)
panel_3 = Panel(detset)
panel_4 = Panel(datatree_to_tensorset)
viewer = ParamViewer(flip)
kmeans = KMeansClustering(Data=datatree_to_tensorset, Clusters=Slider(4, range=0..10), Iterations="500", Seed=123)  # -> Clusters, Indices
crv_4 = Curve(crv)
viewer_2 = ParamViewer(kmeans.Indices)
pln = Plane(flatten(pl_2))
item_3 = ListItem(List=crv_4, Index=kmeans.Indices, Wrap=True)
item_4 = ListItem(List=pln, Index=kmeans.Indices, Wrap=True)
boundary_2 = BoundarySurfaces(Edges=item_3)
lng_4 = ListLength(List=item_4)
panel_5 = Panel(lng_4)
mesh_6 = MeshBrep(
    Brep=boundary_2,
    Settings={GridMaxCount=0, GridMinCount=16, JaggedSeams=False, MaxEdgeLength=0, MinEdgeLength=0.0001, MinTolerance=0, Refine=True, RefineAngle=0, RelativeTolerance=0.65, SimplePlanes=True, Tolerance=0})
division_4 = Division(A=length, B=panel_5)
mcol = MeshColours(Mesh=mesh_6, Colours=merge)
divide_curve_2 = DivideCurve(Curve=curve_6, Count=lng_4, Kinks=False)  # -> Points, Tangents, Parameters
divide_2 = DivideCurve(Curve=graft(cir), Count=division_4, Kinks=False)  # -> Points, Tangents, Parameters
vrot_2 = Rotate(Vector=divide_2.Tangents, Axis=Z, Angle="pi/2")
explode_tree_2 = ExplodeTree(Data=item_4)  # -> Branch0, Branch1, Branch2, Branch3
explode_tree_3 = ExplodeTree(Data=mcol)  # -> Branch0, Branch1, Branch2, Branch3
split_list = SplitList(List=explode_tree_3.Branch1, Index=last_index)  # -> ListA, ListB
split_list_2 = SplitList(List=explode_tree_3.Branch2, Index=last_index_2)  # -> ListA, ListB
split_list_3 = SplitList(List=explode_tree_2.Branch2, Index=last_index_2)  # -> ListA, ListB
split_list_4 = SplitList(List=explode_tree_2.Branch1, Index=last_index)  # -> ListA, ListB
split_list_5 = SplitList(List=explode_tree_2.Branch2, Index=last_index_2)  # -> ListA, ListB
entwine_2 = Entwine(Branch00=explode_tree_2.Branch0, Branch01=split_list_4.ListA, Branch02=split_list_3.ListA, FlattenInputs=True)
entwine_3 = Entwine(Branch00=explode_tree_3.Branch0, Branch01=split_list.ListA, Branch02=split_list_2.ListA, FlattenInputs=True)
orient = Orient(Geometry=entwine_3, Source=entwine_2, Target=pl)  # -> Geometry, Transform
mesh_edges = MeshEdges(Mesh=orient.Geometry)  # -> NakedEdges, InteriorEdges, NonManifoldEdges
mesh_edges_2 = MeshEdges(Mesh=orient.Geometry)  # -> AllE, NakedE
curve_11 = Curve(mesh_edges.NakedEdges)
crv_5 = Curve(curve_11)
join_curves_3 = JoinCurves(Curves=crv_5, Preserve=False)
merge_2 = Merge(Data1=join_curves_3, Data2=join_curves_2)

# ---- group: CSV Contour
crv_6 = Curve(merge_2)

# ----
boundary_surfaces = BoundarySurfaces(Edges=crv_6)
mesh_brep_2 = MeshBrep(
    Brep=boundary_surfaces,
    Settings={GridMaxCount=0, GridMinCount=16, JaggedSeams=False, MaxEdgeLength=0, MinEdgeLength=0.0001, MinTolerance=0, Refine=True, RefineAngle=0, RelativeTolerance=0.65, SimplePlanes=True, Tolerance=0})

flatten_tree = FlattenTree(Tree=crv_6, Path="{0}")
discontinuity = Discontinuity(Curve=flatten_tree, Level=1)  # -> Points, Parameters
area_5 = Area(Geometry=crv_6)  # -> Area, Centroid
average = Average(Input=discontinuity.Points)
flip_matrix = FlipMatrix(Data=average)
scale_2 = Scale(Geometry=flatten_tree, Center=flip_matrix, Factor=number_slider_3)  # -> Geometry, Transform
bounds_2 = Bounds(Numbers=area_5.Area)
list_length = ListLength(List=crv_6)
number_slider_4 = Slider(50, range=0..100)
brep = Brep(<brep referenced from the Rhino model>)
populate_geometry_2 = PopulateGeometry(Geometry=brep, Count=list_length, Seed=1)
deconstruct_domain = DeconstructDomain(Domain=bounds_2)  # -> Start, End
pcen = PolygonCenter(Polyline=graft(scale_2.Geometry))  # -> CenterV, CenterE, CenterA
disc = Discontinuity(Curve=scale_2.Geometry, Level=1)  # -> Points, Parameters
expression = Expression(x=deconstruct_domain.Start, Expression="((x)/π)^½")
divide_curve_3 = DivideCurve(Curve=scale_2.Geometry, Count=10, Kinks=False)  # -> Points, Tangents, Parameters
explode_2 = Explode(Curve=scale_2.Geometry, Recursive=True)  # -> Segments, Vertices
expression_2 = Expression(x=deconstruct_domain.End, Expression="((x)/π)^½")
mesh_brep_3 = MeshBrep(
    Brep=brep,
    Settings={GridMaxCount=0, GridMinCount=16, JaggedSeams=False, MaxEdgeLength=0, MinEdgeLength=0.0001, MinTolerance=0, Refine=True, RefineAngle=0, RelativeTolerance=0.65, SimplePlanes=True, Tolerance=0})
mesh_surface = MeshSurface(Surface=brep, UCount=number_slider_4, VCount=number_slider_4, Overhang=True, Equalize=False)
mesh_surface_2 = MeshSurface(Surface=brep, UCount=number_slider_4, VCount=number_slider_4, Overhang=True, Equalize=False)
radii_2 = Radii(radii)
mesh_7 = Mesh(mesh_surface)
spherecollide = SphereCollide(Radius=1, Strength=1)
imagecircles = ImageCircles(
    Points=populate_geometry_2,
    Mesh=mesh_surface_2,
    Min=expression,
    Max=expression_2,
    Curves=crv_6,
    Strength=Slider(1000, range=0..1000))
panel_6 = Panel("100000")
brep_2 = Brep(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)
softbodycollide = SoftBodyCollide(Strength=10)
spherecollide_2 = SphereCollide(Points=divide_curve_3.Points, Radius=Slider(1, range=0..1), Strength="100000000")
planarize = Planarize(M=scale_2.Geometry, Strength=Slider(1000, range=0..1000))
onmesh = OnMesh(Points=[pcen.CenterV, disc.Points], Mesh=mesh_surface, Strength=Slider(1000, range=0..1000))

# ---- group: Keep each individual shape strongly attached of each center
pt_5 = Point([disc.Points, pcen.CenterV])
crossref = CrossReference(ListA=pt_5, ListB=pt_5, CrossMode=5)  # -> ListA, ListB
ln = Line(StartPoint=crossref.ListA, EndPoint=crossref.ListB)
length_line = LengthLine(Line=ln, Strength="1000000")

# ---- group: Bring center of Shapes together
pt_6 = Point(flatten(pcen.CenterV))
crossref_2 = CrossReference(ListA=pt_6, ListB=pt_6, CrossMode=5)  # -> ListA, ListB
ln_2 = Line(StartPoint=crossref_2.ListA, EndPoint=crossref_2.ListB)
length_line_2 = LengthLine(Line=ln_2, Length="0", Strength="0.5")

# ---- group: Check colision and avoid overlap
line = Line(explode_2.Segments)
collider = Collider(Objects=flatten(line), Radii=Slider(0.3, range=0..1), Strength="100000000")

# ---- group: keep everything on the plane
pt_7 = Point(disc.Points)
anchorxyz = AnchorXYZ(Point=flatten(pt_7), X=False, Y=False, Z=False, Strength="1000000")

# ---- group: keep track of the shape for display
show = Show(G=scale_2.Geometry)

# ----
entwine_4 = Entwine(
    Branch00=show,
    Branch01=[length_line_2, collider, anchorxyz, length_line, grab, onmesh, spherecollide_2, imagecircles, planarize],
    FlattenInputs=True)
solver = Solver(GoalObjects=entwine_4, Reset=reset_2, Threshold=1e-10, Tolerance=0.01, On=on)  # -> I, V, O
bang = ExplodeTree(Data=solver.O)  # -> Branch0, Branch1
curve_12 = Curve(flatten(bang.Branch0))
offset = Offset(Curve=bang.Branch0, Distance=radii, Plane=PlaneXY(0, 0, 0), Corners=1)
discontinuity_2 = Discontinuity(Curve=curve_12, Level=1)  # -> Points, Parameters
average_2 = Average(Input=discontinuity_2.Points)
trim_tree = TrimTree(Tree=average_2, Depth=1)  # -> flatten(Tree)
scale_3 = Scale(Geometry=curve_12, Center=trim_tree, Factor=radii)  # -> graft(Geometry), Transform
discontinuity_3 = Discontinuity(Curve=scale_3.Geometry, Level=1)  # -> Points, Parameters
patch = Patch(Curves=scale_3.Geometry, Points=discontinuity_3.Points, Spans=20, Flexibility=1, Trim=True)  # disabled
curve_13 = Curve(scale_3.Geometry)
