# Grasshopper definition nesting algorithm.gh (Grasshopper 1.0.7)
# plug-ins: Anemone

# ---- group: Stone making tool
brep = Brep(<brep referenced from the Rhino model>)
popgeo = PopulateGeometry(Geometry=brep, Count=Slider(10, range=0..10), Seed=Slider(3, range=0..10))
srf_cp = SurfaceClosestPoint(Point=popgeo, Surface=brep)  # -> Point, UVPoint, Distance
evalsrf = EvaluateSurface(Surface=brep, Point=srf_cp.UVPoint)  # -> Point, Normal, UDirection, VDirection, Frame
number_slider = Slider(110, range=0..200)
box = CenterBox(Base=evalsrf.Frame, X=number_slider, Y=number_slider, Z=Slider(28, range=0..100))
sdiff = SolidDifference(BrepsA=brep, BrepsB=box)

# ---- group: Create field
pt = Point(<point referenced from the Rhino model>)
fspin = SpinForce(Plane=pt, Strength=1, Radius="500", Decay=2)

pt_2 = Point(<point referenced from the Rhino model>)
fspin_2 = SpinForce(Plane=pt_2, Strength=1, Radius="500", Decay=2)

# ----
stones_big = Brep([<brep referenced from the Rhino model> x6])
stones_small = Brep([<brep referenced from the Rhino model> x6])
mergef = MergeFields(Fields=[fspin, fspin_2])

# ---- group: Starting condition
brep_2 = Brep(<brep referenced from the Rhino model>)
jagged = SettingsSpeed()
mesh = MeshBrep(Brep=brep_2, Settings=jagged)
xy = XYPlane(Origin=Point(0, 0, 0))
sec = MeshPlane(Mesh=mesh, Plane=xy)
mesh_2 = Mesh(mesh)
area = Area(Geometry=sec)  # -> Area, Centroid
X = UnitX(Factor=1)
evf = EvaluateField(Field=mergef, Point=area.Centroid)  # -> Tensor, Strength
orient = OrientDirection(Geometry=sec, PointA=area.Centroid, DirectionA=X, PointB=area.Centroid, DirectionB=unitize(evf.Tensor))  # -> Geometry, Transform
transform = Transform(Geometry=mesh_2, Transform=orient.Transform)
initial_crv = Curve(orient.Geometry)
initial_mesh = Mesh(transform)

# ----
mesh_3 = Mesh([<mesh referenced from the Rhino model> x5])

# ---- group: Stone rotator
brep_3 = Brep(stones_small)
jagged_2 = SettingsSpeed()
mesh_4 = MeshBrep(Brep=brep_3, Settings=jagged_2)  # -> graft(Mesh)
volume = Volume(Geometry=mesh_3)  # -> Volume, Centroid
range = Range(Domain="0 to 360", Steps=Slider(12, range=0..100))
lng = ListLength(List=range)
Y = UnitY(Factor=1)
series = Series(Start=0, Step=Slider(200, range=0..1000), Count=lng)
rot3d = Rotate3D(Geometry=mesh_3, Angle=degrees(range), Center=volume.Centroid, Axis=Y)  # -> Geometry, Transform
Y_2 = UnitY(Factor=series)
neg = Negative(Value=Y_2)
move = Move(Geometry=rot3d.Geometry, Motion=neg)  # -> flatten(Geometry), Transform

# ----
loop_start = LoopStart(N=Slider(20, range=0..10000), T=Button(), D0=initial_crv, D2=initial_mesh)  # -> port, Counter, Data, Data_2, Data_3
panel = Panel(loop_start.Counter)
sections_list = Curve(loop_start.Data)
preview = CustomPreview(Geometry=loop_start.Data_3, Material=ColourSwatch(SwatchColor=RGB(56, 89, 30)))

# ---- group: Choose random stone from placed stones
lng_2 = ListLength(List=sections_list)
random = Random(Range=lng_2, Number=1, Seed=loop_start.Counter, Integers=True)
item = ListItem(List=sections_list, Index=random, Wrap=True)

# ---- group: Stone picker
xy_2 = XYPlane(Origin=Point(0, 0, 0))
sec_2 = MeshPlane(Mesh=move.Geometry, Plane=xy_2)  # -> flatten(Curves)
lng_3 = ListLength(List=sec_2)
random_2 = Random(Range=lng_3, Number=1, Seed=loop_start.Counter, Integers=True)
item_2 = ListItem(List=sec_2, Index=random_2, Wrap=True)

# ----
number_slider_2 = Slider(30, range=0..100)
offset = OffsetCurve(Curve=item, Distance=Slider(115, range=0..1000), Plane=PlaneXY(0, 0, 0), Corners=1)
loop_start_2 = LoopStart(Repeat=number_slider_2, Data=loop_start.Counter)  # -> port, Counter, Data
range_2 = Range(Domain=Domain(0, 1), Steps=expr("x-1", number_slider_2))
item_3 = ListItem(List=move.Geometry, Index=random_2, Wrap=True)
item_4 = ListItem(List=range_2, Index=loop_start_2.Counter, Wrap=True)
eval = EvaluateLength(Curve=offset, Length=item_4, Normalized=True)  # -> Point, Tangent, Parameter

# ---- group: Move and rotate the picked stone curve to a point
picked_crv = Curve(item_2)
evf_2 = EvaluateField(Field=mergef, Point=eval.Point)  # -> Tensor, Strength
area_2 = Area(Geometry=picked_crv)  # -> Area, Centroid
X_2 = UnitX(Factor=1)
orient_2 = OrientDirection(Geometry=picked_crv, PointA=area_2.Centroid, DirectionA=X_2, PointB=eval.Point, DirectionB=unitize(evf_2.Tensor))  # -> Geometry, Transform
crvprox = CurveProximity(CurveA=item, CurveB=orient_2.Geometry)  # -> PointA, PointB, Distance
vec2pt = Vector2Pt(PointA=crvprox.PointB, PointB=crvprox.PointA, Unitize=False)  # -> Vector, Length
move_2 = Move(Geometry=orient_2.Geometry, Motion=vec2pt.Vector)  # -> Geometry, Transform

# ----
comp = Compound(Transforms=[orient_2.Transform, move_2.Transform])
mesh_5 = Mesh(item_3)
mesh_6 = Mesh(loop_start.Data_3)
transform_2 = Transform(Geometry=mesh_5, Transform=comp)
preview_2 = CustomPreview(Geometry=move_2.Geometry, Material=ColourSwatch(SwatchColor=RGB(255, 0, 0)))

# ---- group: Check if curve intersects with any other curve
area_3 = Area(Geometry=move_2.Geometry)  # -> Area, Centroid
scale = Scale(Geometry=move_2.Geometry, Center=area_3.Centroid, Factor="0.99")  # -> Geometry, Transform
colom = CollisionOneMany(Collider=scale.Geometry, Obstacles=sections_list)  # -> Collision, Index

# ----
crv = Curve(<curve referenced from the Rhino model>)
incurve = PointInCurve(Point=area_3.Centroid, Curve=crv)  # -> Relationship, Point
equals = Equality(FirstNumber=incurve.Relationship, SecondNumber="0")  # -> Equality, Inequality

incurves = PointInCurves(Point=area_3.Centroid, Curves=sections_list)  # -> Relationship, Index, Point
ma = MassAddition(Input=[incurves.Relationship, colom.Collision, equals.Equality])  # -> Result, PartialResults

# ---- group: Check if curve intersects with any other curve (continued)
equals_2 = Equality(FirstNumber=ma.Result, SecondNumber="0")  # -> Equality, Inequality

# ----
filter = StreamFilter(Gate=equals_2.Equality, Stream1=move_2.Geometry)
filter_2 = StreamFilter(Gate=equals_2.Equality, Stream1=transform_2)
merge = Merge(Data1=mesh_6, Data2=filter_2)  # -> flatten(Result)
loop_end = LoopEnd(
    port=loop_start_2.port,
    Exit=equals_2.Equality,
    Data=loop_start_2.Data,
    TimeOutVal=0,
    pausedState=False,
    state="Output last")
merge_2 = Merge(Data1=sections_list, Data2=filter)  # -> flatten(Result)
loop_end_2 = LoopEnd(
    port=loop_start.port,
    Exit=False,
    Data=merge_2,
    Data_2=loop_end,
    Data_3=merge,
    TimeOutVal=0,
    pausedState=False,
    state="Constant output")  # -> D0, D1, D2
