# Grasshopper definition packing-real-surface.gh (Grasshopper 1.0.7)
# plug-ins: Kangaroo2 Components, MeshEdit Components, Box2D, Pufferfish, OpenNest, meshAnalysis, NGon

number_slider = Slider(100, range=0..100)
unit_z = UnitZ(Factor=Slider(66, range=0..100))
xy_plane = XYPlane(Origin=Point(0, 0, 0))
move = Move(Geometry=xy_plane, Motion=unit_z)  # -> Geometry, Transform
mesh = Mesh(<mesh referenced from the Rhino model>)
circle = Circle(Plane=move.Geometry, Radius=number_slider)
mesh_plane = MeshPlane(Mesh=mesh, Plane=move.Geometry)
curve = Curve(mesh_plane)
custom_preview = CustomPreview(Geometry=curve, Material=ColourSwatch(SwatchColor=RGB(255, 0, 0)))

curve_2 = Curve([<curve referenced from the Rhino model> x15])
area = Area(Geometry=curve_2)  # -> Area, Centroid
series = Series(Start=Slider(650, range=0..1000), Step=Slider(50, range=0..100), Count=Slider(21, range=0..100))
bounds = Bounds(Numbers=series)

unit_y = UnitY(Factor=series)
xz_plane = XZPlane(Origin=Point(0, 0, 0))
mesh_2 = Mesh(<mesh referenced from the Rhino model>)
move_2 = Move(Geometry=xz_plane, Motion=unit_y)  # -> Geometry, Transform
mesh_plane_2 = MeshPlane(Mesh=mesh_2, Plane=move_2.Geometry)

voronoi = Voronoi(Points=area.Centroid, BruteForceOverride=False)
panel = Panel(bounds)
circle_2 = Circle(Plane=move_2.Geometry, Radius=number_slider)
curve_3 = Curve([<curve referenced from the Rhino model> x13])
construct_domain = ConstructDomain(DomainStart=0, DomainEnd=1)
divide_curve = DivideCurve(Curve=curve_3, Count=Slider(13, range=0..100), Kinks=False)  # -> Points, Tangents, Parameters
curve_4 = Curve([<curve referenced from the Rhino model> x25])
range = Range(Domain=construct_domain, Steps=Slider(1, range=0..10))
polyline = PolyLine(Vertices=divide_curve.Points, Closed=Toggle(True))
series_2 = Series(Start=0, Step=Slider(7, range=0..10), Count=Slider(3, range=0..100))
curve_5 = Curve(mesh_plane_2)
crv = Curve([<curve referenced from the Rhino model> x13])
project = Project(Polyline=polyline)  # -> Polyline, Plane
random = Random(Range=range, Number=1, Seed=2)
construct_point = ConstructPoint(XCoordinate=series_2, YCoordinate=graft(series_2), ZCoordinate=0)
curve_6 = Curve([<curve referenced from the Rhino model> x12])
mesh_3 = Mesh(<mesh referenced from the Rhino model>)
crv_2 = Curve([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])
join_curves = JoinCurves(Curves=mesh_plane_2, Preserve=False)
rebuild_curve = RebuildCurve(Curve=curve_5, Count=Slider(11, range=0..100), EndTangents=False)
curve_7 = Curve([<curve referenced from the Rhino model> x13])
convexdecompose = ConvexDecompose(Polygon=project.Polyline)
curve_8 = Curve(convexdecompose)
polygon = Polygon(Plane=construct_point, Radius=random, Segments=6, FilletRadius=0)  # -> Polygon, Length
project_2 = Project(Polyline=curve_8)  # -> Polyline, Plane

# ---- group: CSV Contour
crv_3 = Curve(crv_2)

# ----
boundary_surfaces = BoundarySurfaces(Edges=curve_7)  # -> graft(Surfaces)
mesh_brep = MeshBrep(
    Brep=boundary_surfaces,
    Settings={GridMaxCount=0, GridMinCount=16, JaggedSeams=False, MaxEdgeLength=0, MinEdgeLength=0.0001, MinTolerance=0, Refine=True, RefineAngle=0, RelativeTolerance=0.65, SimplePlanes=True, Tolerance=0})
length = Length(Curve=join_curves)
discontinuity = Discontinuity(Curve=rebuild_curve, Level=1)  # -> Points, Parameters
mesh_4 = Mesh(<mesh referenced from the Rhino model>)
curve_9 = Curve(project_2.Polyline)
triremesh = TriRemesh(Geometry=mesh_brep, Iterations=25)  # -> Triangulation, Dual, Creases
boundaryfirstflatenning = BoundaryFirstFlatenning(Mesh=mesh_4, MapToSphere=False)  # -> Mesh3D, Mesh2D
populate_geometry = PopulateGeometry(Geometry=curve_7, Count=100, Seed=1)
populate_geometry_2 = PopulateGeometry(Geometry=boundary_surfaces, Count=100, Seed=1)
point = Point([<point referenced from the Rhino model> x250])
quad_remesh_settings = QuadRemeshSettings(
    TargetCount=Slider(300, range=0..1000),
    AdaptiveSize=0,
    AdaptiveCount=False,
    HardEdges=False,
    SeamEdges=0,
    Symmetry=0,
    GuideCurves=0)
delaunay_mesh = DelaunayMesh(Points=flatten(point), Plane=PlaneXY(0, 0, 0))
mesh_5 = Mesh(flatten(triremesh.Triangulation))
mesh_6 = Mesh(boundaryfirstflatenning.Mesh2D)
path = FilePath("C:\Users\libish m\Downloads\mosaics\tiling workflow\mosaic variants.psd")
curve_10 = Curve([<curve referenced from the Rhino model> x13])
merge = Merge(Data1=populate_geometry, Data2=populate_geometry_2)
quad_remesh = QuadRemesh(Mesh=delaunay_mesh, Settings=quad_remesh_settings)
panel_2 = Panel(path)
c_script = CSharpScript(geometries=delaunay_mesh, filename="mesh.iges", directory=path, export=Toggle(True))  # inputs geometries: tree of GeometryBase, filename: String, directory: String, export: Boolean
# ---------- c_script: C# usings ----------
using System.IO;
# ---------- c_script: C# ----------
    if(export){

      var guids = new List<Guid>();

      for(int i = 0; i < geometries.BranchCount; i++){
        for(int n = 0; n < geometries.Branches[i].Count; n++){
          var geom = geometries.Branches[i][n];
          var guid = Rhino.RhinoDoc.ActiveDoc.Objects.Add(geom);
          guids.Add(guid);
        }
      }

      Rhino.RhinoDoc.ActiveDoc.Objects.Select(guids);

      string filepath = Path.Combine(directory, filename);
      string cmd = "_-Export " + "\"" + filepath + "\"" + " _Enter _Enter";

      Rhino.RhinoApp.RunScript(cmd, false);

      Rhino.RhinoDoc.ActiveDoc.Objects.Delete(guids, true);
    }
# ---------- end c_script ----------
number_slider_2 = Slider(1.1, range=0..10)
delaunay_mesh_2 = DelaunayMesh(Points=merge, Plane=PlaneXY(0, 0, 0))
radii = Radii(number_slider_2)
mesh_curvature = MeshCurvature(Mesh=quad_remesh, RingSphere=True, RingNSphereRadius=2, Method=2, Static=False)  # -> Mesh, CurvatureValues
define_hobj = DefineHObj(hobj=delaunay_mesh)  # -> out, hobj_2
houdini_primitives = HoudiniPrimitives(hobj=quad_remesh)  # -> out, geometry
houdini_points = HoudiniPoints(hobj=point)  # -> out, points
flatten_tree = FlattenTree(Tree=convexdecompose, Path="{0}")
discontinuity_2 = Discontinuity(Curve=flatten_tree, Level=1)  # -> Points, Parameters
average = Average(Input=discontinuity_2.Points)
flip_matrix = FlipMatrix(Data=average)
area_2 = Area(Geometry=convexdecompose)  # -> Area, Centroid
scale = Scale(Geometry=flatten_tree, Center=flip_matrix, Factor=number_slider_2)  # -> Geometry, Transform
number_slider_3 = Slider(50, range=0..100)
bounds_2 = Bounds(Numbers=area_2.Area)
brep = Brep(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)
list_length = ListLength(List=convexdecompose)
populate_geometry_3 = PopulateGeometry(Geometry=brep, Count=list_length, Seed=1)
deconstruct_domain = DeconstructDomain(Domain=bounds_2)  # -> Start, End
mesh_surface = MeshSurface(Surface=brep, UCount=number_slider_3, VCount=number_slider_3, Overhang=True, Equalize=False)
mesh_7 = Mesh(<mesh referenced from the Rhino model>)
pcen = PolygonCenter(Polyline=graft(scale.Geometry))  # -> CenterV, CenterE, CenterA
disc = Discontinuity(Curve=scale.Geometry, Level=1)  # -> Points, Parameters
expression = Expression(x=deconstruct_domain.Start, Expression="((x)/π)^½")
divide_curve_2 = DivideCurve(Curve=scale.Geometry, Count=10, Kinks=False)  # -> Points, Tangents, Parameters
explode = Explode(Curve=scale.Geometry, Recursive=True)  # -> Segments, Vertices
expression_2 = Expression(x=deconstruct_domain.End, Expression="((x)/π)^½")
mesh_8 = Mesh(mesh_7)

mesh_9 = Mesh(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)
point_2 = Point([Point(32.67093604, 31.42688042, 0), Point(40.41724379, 61.86179707, 0), Point(41.50765949, 29.16834538, 0), Point(48.55260268, 42.25601424, 0), Point(23.41218765, 38.09442124, 0), Point(31.76116309, 26.60961727, 0)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])
panel_3 = Panel("1000")
mesh_10 = Mesh(mesh_8)
mesh_closest_point = MeshClosestPoint(Point=populate_geometry_3, Mesh=mesh_10)  # -> Point, Index, Parameter
c_script_2 = CSharpScript(iCount="100")  # -> out, oPoints; inputs iCount: Int32
# ---------- c_script_2: C# ----------
    Random myRandomGenerator = new Random();

    List<Point3d> points = new List<Point3d>();

    for (int i = 0; i < iCount; i++)
    {
      double x = myRandomGenerator.NextDouble() * 6.0 - 3.0;
      double y = myRandomGenerator.NextDouble() * 6.0 - 3.0;
      double z = 0.0;
      Point3d myRandomPoint = new Point3d(x, y, z);
      points.Add(myRandomPoint);
    }

    oPoints = points;
# ---------- end c_script_2 ----------
poisson = BooleanToggle(False)
run = BooleanToggle(True)
reset = Button()
outputvalues = BooleanToggle(False)
timer = Timer(Interval=1, TimerInterval=5, Target=c_script_4)  # disabled
timer_2 = Timer(Interval=5, TimerInterval=5, Target=c_script_3)
c_script_3 = CSharpScript(
    P=mesh_10,
    textureScale=Slider(1, range=0..1),
    step=run,
    Poisson=poisson,
    reset=reset,
    Output=outputvalues,
    Reference=["C:\Users\libish m\AppData\Roaming\Grasshopper\Libraries\Plankton.dll", "C:\Users\libish m\AppData\Roaming\Grasshopper\Libraries\Plankton.gha"])  # -> out, Mesh, Values, Gradient; inputs P: Mesh, heatPoints: list of Point3d, textureScale: Double, step: Boolean, Poisson: Boolean, reset: Boolean, Output: Boolean
# ---------- c_script_3: C# usings ----------
using Plankton;
using PlanktonGh;
using System.Linq;
using System.Threading.Tasks;
# ---------- c_script_3: C# ----------
    /*
    Script by Daniel Piker 03/07/2020
    This is an implementation of "The Heat Method for Distance Computation"
    by Keenan Crane, Clarisse Weischedel and Max Wardetzky
    https://www.cs.cmu.edu/~kmcrane/Projects/HeatMethod/
    */
    if(reset || pm == null)
    {
      pm = P.ToPlanktonMesh();
      int vc = pm.Vertices.Count;
      storedweights = new double[vc][];
      storedneighbours = new int[vc][];
      values = new double[vc];
      fix = new bool[vc];
      for(int i = 0;i < vc;i++)
      {
        storedweights[i] = cotanWeights(pm, i);
        storedneighbours[i] = pm.Vertices.GetVertexNeighbours(i);
        values[i] = 1;
        for(int j = 0;j < heatPoints.Count;j++)
        {
          if(pm.Vertices[i].ToPoint3d().DistanceToSquared(heatPoints[j]) < 0.001)
          {
            values[i] = 0;
            fix[i] = true;
          }
        }

      }
      gradient = new Vector3d[vc];
      meshOut = P.DuplicateMesh();
    }

    if(step)
    {
      if(!Poisson)
      {
        for(int k = 0;k < 100;k++)
        {
          double[] newValues = new double[values.Length];
          Parallel.For(0, pm.Vertices.Count,
            i => {
            if(!fix[i] && !pm.Vertices.IsBoundary(i))
            {
              int[] neighbours = storedneighbours[i];
              double[] weights = storedweights[i];
              double newValue = 0;
              for(int j = 0;j < neighbours.Length;j++)
              {
                newValue += weights[j] * values[neighbours[j]];
              }
              newValues[i] = newValue;
            }
            else newValues[i] = 0;
            });
          values = newValues;
        }
        gradient = gradients(pm, values);
        edgeGradient = null;
      }

      else
      {
        if(edgeGradient == null)
        {
          edgeGradient = new Vector3d[pm.Halfedges.Count / 2];
          for(int i = 0;i < pm.Halfedges.Count / 2;i++)
          {
            int start = pm.Halfedges[2 * i].StartVertex;
            int end = pm.Halfedges[(2 * i) + 1].StartVertex;
            Vector3d sv = gradient[start];
            Vector3d ev = gradient[end];
            sv.Unitize();
            ev.Unitize();
            Vector3d avgGradient = sv + ev;
            avgGradient.Unitize();
            edgeGradient[i] = avgGradient;
          }
        }
        for(int k = 0;k < 100;k++)
        {
          double[] heChange = new double[pm.Halfedges.Count];
          Parallel.For(0, pm.Halfedges.Count / 2,
            i => {
            int start = pm.Halfedges[2 * i].StartVertex;
            int end = pm.Halfedges[(2 * i) + 1].StartVertex;
            Vector3d edgeVector = pm.Vertices[end].ToPoint3d() - pm.Vertices[start].ToPoint3d();
            double projected = edgeVector * edgeGradient[i];
            double currentDifference = values[end] - values[start];
            double change = currentDifference - projected;
            heChange[2 * i] = 0.5 * change;
            heChange[(2 * i) + 1] = -0.5 * change;
            });

          Parallel.For(0, pm.Vertices.Count,
            i => {
            //if(fix[i])
            //{
            //  values[i] = 0;
            //}
            //else
            {
              double[] weights = storedweights[i];
              int[] halfedges = pm.Vertices.GetHalfedges(i);
              for(int j = 0;j < halfedges.Length;j++)
              {
                values[i] += heChange[halfedges[j]] * weights[j];
              }
            }
            });

        }
      }
    }


    for(int i = 0;i < meshOut.Vertices.Count;i++)
    {
      meshOut.TextureCoordinates.SetTextureCoordinate(i, new Point2f(0, (float) (values[i] * textureScale)));
    }

    Mesh = meshOut;
    //the scalar and gradient vectors per vertex should you want them, though outputing these lists slows things down, so not included by default
    if(Output)
    {
      Values = values;
      Gradient = gradient;
    }
# ---------- c_script_3: C# additional code ----------
  PlanktonMesh pm;
  double[] values;
  double[][] storedweights;
  int[][] storedneighbours;
  Vector3d[] gradient;
  Vector3d[] edgeGradient;
  bool[] fix;
  Mesh meshOut;

  static Vector3d[] gradients(PlanktonMesh P, double[] values)
  {
    Vector3d[] halfedgeGradients = new Vector3d[P.Halfedges.Count];
    for(int i = 0;i < P.Halfedges.Count / 2;i++)
    {
      int start = P.Halfedges[2 * i].StartVertex;
      int end = P.Halfedges[2 * i + 1].StartVertex;
      Vector3d v = P.Vertices[end].ToPoint3d() - P.Vertices[start].ToPoint3d();
      double lengthSquared = v.SquareLength;
      double diff = values[end] - values[start];
      Vector3d edgeGradient = v * (diff / lengthSquared);
      halfedgeGradients[2 * i] = halfedgeGradients[2 * i + 1] = edgeGradient;
    }
    Vector3d[] vertexGradients = new Vector3d[P.Vertices.Count];
    for(int i = 0;i < P.Vertices.Count;i++)
    {
      double[] weights = cotanWeights(P, i);
      Vector3d gradient = new Vector3d();
      int[] halfedges = P.Vertices.GetHalfedges(i);
      for(int j = 0;j < halfedges.Length;j++)
      {
        gradient += halfedgeGradients[halfedges[j]] * weights[j];
      }
      vertexGradients[i] = gradient;
    }
    return vertexGradients;
  }

  static double[] cotanWeights(PlanktonMesh P, int i)
  {
    int[] Neighbours = P.Vertices.GetVertexNeighbours(i);
    Point3d Vertex = P.Vertices[i].ToPoint3d();
    int valence = P.Vertices.GetValence(i);
    Point3d[] NeighbourPts = new Point3d[valence];
    Vector3d[] Radial = new Vector3d[valence];
    Vector3d[] Around = new Vector3d[valence];
    double[] CotWeight = new double[valence];
    double WeightSum = 0;
    for (int j = 0; j < valence; j++)
    {
      NeighbourPts[j] = P.Vertices[Neighbours[j]].ToPoint3d();
      Radial[j] = NeighbourPts[j] - Vertex;
    }
    for (int j = 0; j < valence; j++)
    {
      Around[j] = NeighbourPts[(j + 1) % valence] - NeighbourPts[j];
    }
    for (int j = 0; j < Neighbours.Length; j++)
    {
      int previous = (j + valence - 1) % valence;
      Vector3d Cross1 = Vector3d.CrossProduct(Radial[previous], Around[previous]);
      double Dot1 = Radial[previous] * Around[previous];
      int next = (j + 1) % valence;
      Vector3d Cross2 = Vector3d.CrossProduct(Radial[next], Around[j]);
      double Dot2 = Radial[next] * Around[j];
      CotWeight[j] = Math.Abs(Dot1 / Cross1.Length) + Math.Abs(Dot2 / Cross2.Length);
      WeightSum += CotWeight[j];
    }
    for (int j = 0; j < CotWeight.Length; j++) CotWeight[j] /= WeightSum;
    return CotWeight;
  }
# ---------- end c_script_3 ----------
path_2 = FilePath("D:\Pictures\RAINBOW_TEXTURE.jpg")
c_script_4 = CSharpScript(iReset=Button(), iStartingPositions=flatten(populate_geometry_3))  # -> out, oCenters; inputs iReset: Boolean, iStartingPositions: list of Point3d
# ---------- c_script_4: C# usings ----------
using System.IO;
using System.Linq;
using System.Data;
using System.Drawing;
using System.Reflection;
using System.Windows.Forms;
using System.Xml;
using System.Xml.Linq;
using System.Runtime.InteropServices;

using Rhino.DocObjects;
using Rhino.Collections;
using GH_IO;
using GH_IO.Serialization;
# ---------- c_script_4: C# ----------
    if (iReset || centers == null)
      centers = new List<Point3d>(iStartingPositions);

    List<Vector3d> totalMoves = new List<Vector3d>();
    List<double> collisionCounts = new List<double>();

    for (int i = 0; i < centers.Count; i++)
    {
      totalMoves.Add(new Vector3d(0.0, 0.1, 0.0));
      collisionCounts.Add(0.0);
    }


    double collisionDistance = 2.0;

    for (int i = 0; i < centers.Count; i++)
      for (int j = i + 1; j < centers.Count; j++)
      {
        double d = centers[i].DistanceTo(centers[j]);
        if (d > collisionDistance) continue;
        Vector3d move = centers[i] - centers[j];
        move.Unitize();
        move *= 0.5 * (collisionDistance - d);
        totalMoves[i] += move;
        totalMoves[j] -= move;
        collisionCounts[i] += 1.0;
        collisionCounts[j] += 1.0;
      }

    for (int i = 0; i < centers.Count; i++)
      if (collisionCounts[i] != 0.0)
        centers[i] += totalMoves[i] / collisionCounts[i];;

    oCenters = centers;
# ---------- c_script_4: C# additional code ----------
  List<Point3d> centers;
# ---------- end c_script_4 ----------
c_script_5 = CSharpScript(texture=path_2)  # -> out, A; inputs texture: String
# ---------- c_script_5: C# usings ----------
using Rhino.DocObjects;
# ---------- c_script_5: C# ----------
    Material material = new Material();
    material.SetBitmapTexture(texture);
    A = new GH_Material(Rhino.Render.RenderMaterial.CreateBasicMaterial(material));
# ---------- end c_script_5 ----------
preview = CustomPreview(Geometry=c_script_3.Mesh, Material=c_script_5.A)
unit_vector = UnitVector(Vector=c_script_3.Values)
vector = Vector(c_script_3.Values)
amplitude = Amplitude(Vector=mesh_closest_point.Point, Amplitude=c_script_3.Values)
cir = Circle(Plane=c_script_4.oCenters, Radius="1")
c_script_6 = CSharpScript(M=c_script_3.Mesh)  # -> out, Contours; inputs M: Mesh, contourCount: Int32
# ---------- c_script_6: C# usings ----------
using System.Linq;
using System.Threading.Tasks;
# ---------- c_script_6: C# ----------
    List<Line> all = new List<Line>();
    List<Line>[] contours = new List<Line>[contourCount];
    double[] values = new double[M.Vertices.Count];
    for(int i = 0;i < M.Vertices.Count;i++) values[i] = M.TextureCoordinates[i].Y;
    double lower = values.Min();
    double upper = values.Max();
    double stepsize = (upper - lower) / (contourCount + 1.0);

    Parallel.For(0, contourCount,
      j => {
      double iso = lower + ((j + 1) * stepsize);
      List<Line> lines = new List<Line>();
      for(int i = 0;i < M.Faces.Count;i++)
      {
        int va = M.Faces[i].A;
        int vb = M.Faces[i].B;
        int vc = M.Faces[i].C;
        double a = M.TextureCoordinates[va].Y - iso;
        double b = M.TextureCoordinates[vb].Y - iso;
        double c = M.TextureCoordinates[vc].Y - iso;
        Point3d pa = M.Vertices.Point3dAt(va);
        Point3d pb = M.Vertices.Point3dAt(vb);
        Point3d pc = M.Vertices.Point3dAt(vc);
        
        List<Point3d> ends = new List<Point3d>();
        if(a < 0 != b < 0)
        {
          double wa = b / (b - a);
          double wb = 1 - wa;
          ends.Add(wa * pa + wb * pb);
        }
        if(a < 0 != c < 0)
        {
          double wa = c / (c - a);
          double wc = 1 - wa;
          ends.Add(wa * pa + wc * pc);
        }
        if(c < 0 != b < 0)
        {
          double wb = c / (c - b);
          double wc = 1 - wb;
          ends.Add(wb * pb + wc * pc);
        }
        if(ends.Count == 2) lines.Add(new Line(ends[0], ends[1]));
      }
      contours[j] = lines;
      });

    DataTree<Line> contoursTree = new DataTree<Line>();
    for(int i = 0; i < contourCount;i++)
    {
      GH_Path path = new GH_Path(i);
      for (int j = 0; j < contours[i].Count;j++)
      {
        contoursTree.Add(contours[i][j], path);
      }
    }

    Contours = contoursTree;
# ---------- end c_script_6 ----------
vector_display_ex = VectorDisplayEx(Point=mesh_closest_point.Point, Vector=amplitude, Colour=RGB(0, 0, 0), Width=Slider(10, range=0..10))

# ---- group: Area centroid of vectors
mesh_area = MeshArea(Mesh=mesh_10)  # -> Area, Centroid

# ----
radii_2 = Radii(radii)
rigidbodycollide = RigidBodyCollide(Strength=1)
imagecircles = ImageCircles(
    Points=populate_geometry_3,
    Mesh=mesh_8,
    Min=expression,
    Max=expression_2,
    Curves=convexdecompose,
    Strength=Slider(1000, range=0..1000))

# ---- group: Check colision and avoid overlap
line = Line(explode.Segments)
collider = Collider(Objects=flatten(line), Radii=Slider(0.3, range=0..1), Strength="10000000")

# ----
panel_4 = Panel("100000")

# ---- group: keep everything on the plane
pt = Point(disc.Points)
anchorxyz = AnchorXYZ(Point=flatten(pt), X=False, Y=False, Z=False, Strength="1000000")

# ---- group: Keep each individual shape strongly attached of each center
pt_2 = Point([disc.Points, pcen.CenterV])
crossref = CrossReference(ListA=pt_2, ListB=pt_2, CrossMode=5)  # -> ListA, ListB
ln = Line(StartPoint=crossref.ListA, EndPoint=crossref.ListB)
length_line = LengthLine(Line=ln, Strength="10000")

# ----
brep_2 = Brep(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)

# ---- group: Bring center of Shapes together
pt_3 = Point(flatten(pcen.CenterV))
crossref_2 = CrossReference(ListA=pt_3, ListB=pt_3, CrossMode=5)  # -> ListA, ListB
ln_2 = Line(StartPoint=crossref_2.ListA, EndPoint=crossref_2.ListB)
length_line_2 = LengthLine(Line=ln_2, Length="0", Strength="0.5")

# ----
softbodycollide = SoftBodyCollide(Strength=10)
spherecollide = SphereCollide(Points=divide_curve_2.Points, Radius=Slider(1, range=0..1), Strength="10000000")
onmesh = OnMesh(Points=[pcen.CenterV, disc.Points], Mesh=mesh_8, Strength=Slider(1000, range=0..1000))
planarize = Planarize(M=scale.Geometry, Strength=Slider(1000, range=0..1000))

# ---- group: ViewPort Interaction (Hold Alt + Left Mouse Button)
grab = Grab(On=True, Strength=1, Range=3)

# ---- group: keep track of the shape for display
show = Show(G=scale.Geometry)

# ----
number_slider_4 = Slider(100, range=0..100)
entwine = Entwine(
    Branch00=show,
    Branch01=[length_line_2, collider, anchorxyz, length_line, grab, onmesh, spherecollide, imagecircles, planarize],
    FlattenInputs=True)

reset_2 = Button()
on = BooleanToggle(True)

solver = Solver(GoalObjects=entwine, Reset=reset_2, Threshold=1e-10, Tolerance=0.01, On=on)  # -> I, V, O
bang = ExplodeTree(Data=solver.O)  # -> Branch0, Branch1
curve_11 = Curve(flatten(bang.Branch0))
discontinuity_3 = Discontinuity(Curve=curve_11, Level=1)  # -> Points, Parameters
offset = Offset(Curve=bang.Branch0, Distance=radii, Plane=PlaneXY(0, 0, 0), Corners=1)
average_2 = Average(Input=discontinuity_3.Points)
trim_tree = TrimTree(Tree=average_2, Depth=1)  # -> flatten(Tree)
scale_2 = Scale(Geometry=curve_11, Center=trim_tree, Factor=radii)  # -> graft(Geometry), Transform
discontinuity_4 = Discontinuity(Curve=scale_2.Geometry, Level=1)  # -> Points, Parameters
patch = Patch(Curves=scale_2.Geometry, Points=discontinuity_4.Points, Spans=20, Flexibility=1, Trim=True)  # disabled

# ==== cluster HoudiniPoints: Provides access to point data of houdini object.
hobj = ClusterInput()  # hObj [houGh.hGeo]: Intermediary houGh.hGeo python object that stores the houdini and grasshopper data and provides functionality for reading and writing json filehObj is the instance of type hGeo witch is the puyhon interpretation of the houdini data.
hpoints = GhPythonScript(hObj=hobj)  # -> out, points
# ---------- hpoints: Python ----------
import Rhino as rh
import System as s
import houGH as jr
reload(jr)

hPoints =  hObj.pointattributes[0].vValues
points = []
for data in hPoints:
    points.append(rh.Geometry.Point3d(*data))
# ---------- end hpoints ----------
out = ClusterOutput(hpoints.out)  # Out [string]: Standard output of the underlying python component.
points = ClusterOutput(hpoints.points)  # Points [point3d]: Points of the houdini object.

# ==== cluster DefineHObj: Generates hObj. In houdini, geometry is composed of points, vertices, primitives, attributes and groups associations. Define hObj component automatically generates point and vertex structure of the input grasshopper geometry. Attributes and groups are generated by define attribute and define group components.
primitives = ClusterInput()  # List of grasshopper geometry. Supports only polyline, NURBS curve and mesh objects.
attributes = ClusterInput()  # Attributes [hGeo.group]: List of attributes to append to hObj.
groups = ClusterInput()  # Groups [hGeo.group]: List of groups to append to hObj.
hobj = ClusterInput()  # hObj [houGh.hGeo]: Optional hObj to append the additional data to. hObj is intermediary houGh.hGeo python object that stores the houdini and grasshopper data and provides functionality for reading and writing json files.
defhgeo = GhPythonScript(hObj=hobj, primitives=primitives, attributes=attributes, groups=groups)  # -> out, hObj; inputs primitives: list, attributes: list, groups: list
# ---------- defhgeo: Python ----------
import houGH as hg
import Rhino as rh
import Grasshopper as gh
import copy

if hObj:
    hGeo = copy.deepcopy(hObj)
    #tree =  hGeo.primVerticesTree
    #hGeo = hObj
else:
    hGeo = hg.hGeo()
    
    #init empty point attribute
    values = gh.DataTree[float]()
    hAttribute = hg.attribute()
    hAttribute.defAttrib("pointattributes", "num", "P", values, 3)
    hGeo.pointattributes.append(hAttribute)

hGeo.addAttributes(attributes)
hGeo.addPrimitives(primitives)
hGeo.addGroups(groups)

hGeo.genGhData()

hObj = hGeo
# ---------- end defhgeo ----------
hobj_2 = ClusterOutput(defhgeo.hObj)  # hObj [houGh.hGeo]: Intermediary houGh.hGeo python object that stores the houdini and grasshopper data and provides functionality for reading and writing json files.
out = ClusterOutput(defhgeo.out)  # Out [string]: Standard output of the underlying python component.

# ==== cluster HoudiniPrimitives: Provides access to primitives data of the houdini object. Primitives are geometry of the houdini data. Supported types are polygon(aka surface, represented as mesh face in grasshopper. At the moment only tris and quads are supported), polyline (open polygon, this can be nGon) and NURBS curve.
hobj = ClusterInput()  # hObj [houGh.hGeo]: Intermediary houGh.hGeo python object that stores the houdini and grasshopper data and provides functionality for reading and writing json filehObj is the instance of type hGeo witch is the puyhon interpretation of the houdini data.
hprimitives = GhPythonScript(hObj=hobj)  # -> out, geo
# ---------- hprimitives: Python ----------
import Rhino as rh
import System as s
import houGH as jr
reload(jr)

geo = []

for i in hObj.primitives:
    #print i.GHGeo
    geo += i.GHGeo

verts =  hObj.vertexTree
# ---------- end hprimitives ----------
out = ClusterOutput(hprimitives.out)  # Out [string]: Standard output of the underlying python component.
geometry = ClusterOutput(hprimitives.geo)  # Geometry [Rhino.GeometryBase]: Grasshopper representation of the houdini geometry. Supported types are polygon(aka surface, represented as mesh face in grasshopper. At the moment only tris and quads are supported), polyline (open polygon, this can be nGon) and NURBS curve.
